# Grasshopper definition P01_DogOrRobot_WhereIsMyBurrito_V15.gh (Grasshopper 1.0.7)
# plug-ins: Machina, Robots, Fologram For Grasshopper Utilities, LadybugGrasshopper, Fologram for Grasshopper

# ----
# 01
_00_confirming = LBFalseStartToggle(False)
_00_startplaying = LBFalseStartToggle(False)
_01_puppy_dawg = ValueList({"Cheeky Puppy": 0, "Nice Puppy": 1}, selected="Nice Puppy")
_02_robotspeed = Slider(105, range=50..150)

list = FlagFields({"Shoulder": 1, "Elbow": 2, "Wrist": 4}, selected="Shoulder")
list_2 = ValueList({"Joint", "Linear"}, selected="Joint")
output_robot_configuration = Data(list)
output_robot_motion = Data(list_2)

main_tracker = Panel("Pixel 6a")
# Admin Interface
input_connecttobridge = Data(_00_confirming)
input_dog_character = Data(_01_puppy_dawg)
input_robotspeed = Data(_02_robotspeed)
input_startplaying = Data(_00_startplaying)
input_device = Data(flatten(main_tracker))

# ----
# Package(s) Needed: Fologram (https://fologram.com/download)
# Machina (https://github.com/RobotExMachina)
# Robot (https://www.food4rhino.com/en/app/robots ) - _Packagermanager
# Ladybug (https://www.ladybug.tools/ladybug/docs/)
# READ ME
# Note(s): 1. Make sure the Rhino project is in "mm".
# 2. Make sure you launched Machina Bridge.
# 3. Connect to the same network as the robots.
# Tested In: 240307_In Rhino 7_weiwin.loy@hdr.qut.edu.au.
changes = Panel("House Keeping")
robotic_arm_ip_address = Panel("192.168.3.66")
# DESIGN LABS
# USER INPUTS
# AUTOMATIC INPUTS
# AUTOMATIC INPUTS
augdoc = AugmentedDocument(
    augmented_trigger_0_key=_00_confirming,
    augmented_trigger_1_key=_01_puppy_dawg,
    augmented_trigger_2_key=_02_robotspeed,
    num_augmented_triggers=3)

input_connecttobridge_2 = Data(input_connecttobridge)
# 01
panel = Panel("GH_P01")
# Connection to machina bridge
connect = Connect(URL="ws://127.0.0.1:6999/Bridge", Name=panel, Connect=input_connecttobridge_2, Connect_2=input_connecttobridge_2)  # -> Status, Bridge
output_bridge = Data(connect.Bridge)

# ---- group: FIXED UNLESS OTHER ROBOT COMES ALONG
# 02
list_3 = RobotsLibrary({"UR3e", "UR5e", "UR10e", "UR16e", "UR3", "UR5", "UR10"}, selected="UR10", Type=0)

# ---- group: SET COORDINATE AS 0,0,0, XY PLANE
# 01
# BASE INPUT
panel_2 = Panel("0")
# Establish robot base point
pt = ConstructPoint(XCoordinate=panel_2, YCoordinate=panel_2, ZCoordinate=panel_2)
xy = XYPlane(Origin=pt)
output_originplane = Plane(xy)

# ---- group: INPUT
para_gumballlength = Data(50)
para_fontsize = Data(15)
output_originplane_2 = Plane(output_originplane)
para_pointoffset = Data(15)

# ---- group: INPUT_ROBOT BASE
# 02
# NOTE(S): Please reconfigure robot base if you are not using UR10
output_originplane_3 = Plane(output_originplane)
robot_base_mm = Panel("70")
# Establish robot base (for coordination)
dom = ConstructDomain(DomainStart=robot_base_mm, DomainEnd=expr("-x", robot_base_mm))
rectangle = Rectangle(Plane=output_originplane_3, XSize=dom, YSize=dom, Radius=0)  # -> Rectangle, Length

# ---- group: INPUT_BASE PLATE
output_originplane_4 = Plane(output_originplane)
# REQUIRE USER INPUTS
base_plate_mm = Panel("150")
dom_2 = ConstructDomain(DomainStart=base_plate_mm, DomainEnd=expr("-x", base_plate_mm))
rectangle_2 = Rectangle(Plane=output_originplane_4, XSize=dom_2, YSize=dom_2, Radius=0)  # -> Rectangle, Length

# ----
output_originplane_5 = Plane(output_originplane)
# Establish robot geometry
loadrobot = LoadRobotSystem(Name=list_3, Base=output_originplane_5)
output_robot_system = Data(loadrobot)

input_armhub_homeposition = Data(["0", "-90", "0", "-90", "0", "0"])
input_robotsystem = Data(output_robot_system)

# ---- group: DECONSTRUCT PLANE
deplane = DeconstructPlane(Plane=output_originplane_2)  # -> Origin, XAxis, YAxis, ZAxis

# ----
degtorad = DegreesToRadians(Degrees=input_armhub_homeposition, RobotSystem=input_robotsystem, MechanicalGroup=0)
input_establishedjointposition = Data(degtorad)

output_robot_system_2 = Data(output_robot_system)
input_establishedjointposition_2 = Data(input_establishedjointposition)

# ---- group: ROBOT CONFIGURATION
# NOTE(S): // This is to establish to the full extent of the robot
joints = JointsParameter(input_establishedjointposition_2)
target = CreateTarget(Joints=joints, IsCartesian=False)
K = Kinematics(RobotSystem=output_robot_system_2, Target=target, DisplayGeometry=False)  # -> Meshes, Joints, Planes, Errors

# ---- group: EXTRAPOLATE GH LINES
line = LineSDL(Start=deplane.Origin, Direction=deplane.XAxis, Length=para_gumballlength)
line_2 = LineSDL(Start=deplane.Origin, Direction=deplane.YAxis, Length=para_gumballlength)
line_3 = LineSDL(Start=deplane.Origin, Direction=deplane.ZAxis, Length=para_gumballlength)

# ----
entwine = Entwine(Branch00=rectangle.Rectangle, Branch01=rectangle_2.Rectangle, FlattenInputs=True)  # -> flatten(Result)
# Visualise in Fologram
# One-time
sync = SyncGeometry(Geometry=entwine, Material=ColourSwatch(SwatchColor=RGB(255, 255, 255)))

panel_3 = Panel(connect.Status)

relocate_txt_pt = RelocateTxtPt(C=line, A=deplane.XAxis, para_pointoffset=para_pointoffset)
relocate_txt_pt_2 = RelocateTxtPt(C=line_2, A=deplane.YAxis, para_pointoffset=para_pointoffset)
relocate_txt_pt_3 = RelocateTxtPt(C=line_3, A=deplane.ZAxis, para_pointoffset=para_pointoffset)
text_dot = ConstructTextDot(Text="X", Point=relocate_txt_pt, Size=para_fontsize)
text_dot_2 = ConstructTextDot(Text="Z", Point=relocate_txt_pt_3, Size=para_fontsize)
text_dot_3 = ConstructTextDot(Text="Y", Point=relocate_txt_pt_2, Size=para_fontsize)
sync_2 = SyncGeometry(Geometry=text_dot)
sync_3 = SyncGeometry(Geometry=text_dot_3)
sync_4 = SyncGeometry(Geometry=text_dot_2)

# ---- group: CREATE TOP AND BASE PLANE
output_robotjointplane = Plane(K.Planes)

# ----
# PROCESSING FUNCTIONS
# HELPERS
# Visualise in Fologram
image = ImageSampler(Filter="Colour", Interpolate=False, Umax=1, Umin=0, Vmax=1, Vmin=0, Wrap=1)

# ---- group: FOLOGRAM SYNC TXT
sync_5 = SyncGeometry(Geometry=line_3, Material=ColourSwatch(SwatchColor=RGB(0, 0, 255)))
sync_6 = SyncGeometry(Geometry=line_2, Material=ColourSwatch(SwatchColor=RGB(0, 255, 0)))
sync_7 = SyncGeometry(Geometry=line, Material=ColourSwatch(SwatchColor=RGB(255, 0, 0)))

# ---- group: HeadsetPosition
event = EventType(1)
# 03
filter_headset_only = BooleanToggle(True)
# Head Tracking (Fologram)
devices = GetDevices(Event=event, Headset=filter_headset_only, outputAllData=False)
input_device_2 = Data(flatten(input_device))
device = DeconstructDevice(Device=devices)  # -> Plane, Name, Type
expression = Expression(x=device.Name, y=input_device_2, Expression="if(x=y,true,false)")
cull = CullPattern(List=devices, CullPattern=expression)
pt_phonelocation = Point(cull)

# ----
# MAIN FUNCTION
# UI / OUTPUTS
# PUPPY-HUMAN INTERACTION
# 01
trigger = Trigger(Interval=5000, TimerInterval=5000, Target=[send, event])

_00_dog_character = Data(input_dog_character)

rec = DataRecorder(pt_phonelocation, DataLimit=1, RecordData=True)
input_phoneposition = Data(rec)

# ---- group: ESTABLISH TRACKED POINT
input_phoneposition_2 = Data(input_phoneposition)

# ----
# Tracked Item
rec_output_selectedpoint = DataRecorder(input_phoneposition_2, DataLimit=1, RecordData=True)

# ---- group: LOCATION OF TRACKED POINT
input_trackingpoint = Point(rec_output_selectedpoint)
pdecon = Deconstruct(Point=input_trackingpoint)  # -> XComponent, YComponent, ZComponent
pt_2 = ConstructPoint(XCoordinate=0, YCoordinate=0, ZCoordinate=pdecon.ZComponent)
dist = Distance(PointA=input_trackingpoint, PointB=pt_2)
float_distanceheadset_xyorigin = Data(dist)

# ---- group: ROBOT REACTION / ROBOT RETREAT
input_robotspeed_2 = Data(input_robotspeed)
# Grasshopper | Machina (real-time interaction)
speedto = SpeedTo(Speed=input_robotspeed_2, Relative=False)

# ---- group: ROBOT REACTION / ROBTO EXTE
input_robotspeed_3 = Data(input_robotspeed)
speedto_2 = SpeedTo(Speed=input_robotspeed_3, Relative=False)

# ---- group: RETRIEVE ALBOW & FLANGE POSITION
# 02
output_robotjointplane_2 = Plane(output_robotjointplane)
# Retrieve Robot Albow Position
item = ListItem(List=output_robotjointplane_2, Index=1, Wrap=True)
item_2 = ListItem(List=output_robotjointplane_2, Index=-1, Wrap=True)
pt_albow = Point(item)
pt_tcp = Point(item_2)
pdecon_2 = Deconstruct(Point=pt_albow)  # -> XComponent, YComponent, ZComponent
pdecon_3 = Deconstruct(Point=pt_tcp)  # -> XComponent, YComponent, ZComponent
subtraction = Subtraction(A=pdecon_3.ZComponent, B=pdecon_2.ZComponent)
robot_extent_distance = Data(subtraction)

# ----
input_albowpoint = Point(pt_albow)
input_trackingpoint_2 = Point(rec_output_selectedpoint)

# ---- group: VALUE DISTANCE / RETREATING DISTANCE
# 04
# Dog Behaviour
robot_extent_distance_2 = Data(robot_extent_distance)
float_roboretreat_distance = Slider(900, range=0..5000)

# ---- group: VALUE DISTANCE / EXTEND DISTANCE
robot_extent_distance_3 = Data(robot_extent_distance)
float_robotextent_distance = Slider(1100, range=0..5000)

# ---- group: VALUE DISTANCE / TRIGGERING CONDITION
robot_extent_distance_4 = Data(robot_extent_distance)
float_triggerreaction_distance = Slider(1800, range=0..10000)

# ---- group: VALUE DISTANCE / PAUSE CONDITION
robot_extent_distance_5 = Data(robot_extent_distance)
float_robotwillpause_distance = Slider(1500, range=0..10000)

# ----
ln = Line(StartPoint=input_albowpoint, EndPoint=input_trackingpoint_2)
len = Length(Curve=ln)

# ---- group: VALUE DISTANCE / RETREATING DISTANCE
division = Division(A=float_roboretreat_distance, B=1300)
multiplication = Multiplication(A=robot_extent_distance_2, B=division)
float_roboretreat = Data(multiplication)

# ---- group: VALUE DISTANCE / TRIGGERING CONDITION
division_2 = Division(A=float_triggerreaction_distance, B=1300)
multiplication_2 = Multiplication(A=robot_extent_distance_4, B=division_2)
float_triggercondition = Data(multiplication_2)

# ----
_00_dog_character_2 = Data(input_dog_character)
float_distanceheadset_xyorigin_2 = Data(float_distanceheadset_xyorigin)
input_distancebetweenhrtotriggerreaction = Data(float_triggercondition)

# ---- group: VALUE DISTANCE / PAUSE CONDITION
division_3 = Division(A=float_robotwillpause_distance, B=1300)
multiplication_3 = Multiplication(A=robot_extent_distance_5, B=division_3)
float_robotpausingcondition = Data(multiplication_3)

# ----
pt_albow_2 = Point(pt_albow)
pt_phone = Point(input_phoneposition)
data = Data(float_robotpausingcondition)
subtraction_2 = Subtraction(A=data, B=100)
dist_2 = Distance(PointA=pt_phone, PointB=pt_albow_2)
smaller = SmallerThan(FirstNumber=dist_2, SecondNumber=data)  # -> SmallerThan, OrEqualTo
smaller_2 = SmallerThan(FirstNumber=dist_2, SecondNumber=subtraction_2)  # -> SmallerThan, OrEqualTo
_02_usertoo_close = Data(smaller_2.SmallerThan)
_01_too_close = Data(smaller.SmallerThan)

# ---- group: VALUE DISTANCE / EXTEND DISTANCE
division_4 = Division(A=float_robotextent_distance, B=1300)
multiplication_4 = Multiplication(A=robot_extent_distance_3, B=division_4)
float_robotextent = Data(multiplication_4)

# ----
# NOTE(S): Doggy will become checky
# NOTE(S): Doggy will come to approach you.
expression_2 = Expression(x=float_distanceheadset_xyorigin_2, y=input_distancebetweenhrtotriggerreaction, Expression="if(y<x,0,1)")
expression_3 = Expression(x=float_distanceheadset_xyorigin_2, y=input_distancebetweenhrtotriggerreaction, Expression="if(x<y,0,1)")
filter = StreamFilter(Gate=_00_dog_character_2, Stream0=expression_3, Stream1=expression_2)
_01_doggy_behaviour = Data(filter)

# ---- group: Cheeky
float_curvelength = Data(len)
float_roboretreat_2 = Data(float_roboretreat_distance)
smaller_3 = SmallerThan(FirstNumber=float_curvelength, SecondNumber=expr("x+50", float_roboretreat_2))  # -> SmallerThan, OrEqualTo
output_smaller = Data(smaller_3.OrEqualTo)

# ---- group: NicePuppy
float_curvelength_2 = Data(len)
float_robotextent_2 = Data(float_robotextent_distance)
smaller_4 = SmallerThan(FirstNumber=float_curvelength_2, SecondNumber=expr("x+50", float_robotextent_2))  # -> SmallerThan, OrEqualTo
output_smaller_2 = Data(smaller_4.OrEqualTo)

# ---- group: TRIGGERING CONDITION
rec_2 = DataRecorder(_01_too_close, DataLimit=1, RecordData=True)
rec_3 = DataRecorder(_02_usertoo_close, DataLimit=1, RecordData=True)

# ----
filter_2 = StreamFilter(Gate=_00_dog_character, Stream0=output_smaller, Stream1=output_smaller_2)
bool_isincriclelimit_tooclose = Data(filter_2)

# ---- group: TRIGGER CONDITION
# Disable robot motiion if users are too close
_01_user_too_close = Data(rec_3)
T = StateGate(States=_01_user_too_close)

# ---- group: ROBOT REACTION
bool_isincriclelimit_tooclose_2 = Data(bool_isincriclelimit_tooclose)
T_2 = StateGate(States=bool_isincriclelimit_tooclose_2, LinkTarget=_02_doggy_reaction)

# ----
input_robotsystem_2 = Data(output_robot_system)
_00_enable_to_check_if_script_working = LBFalseStartToggle(False)

_01_doggy_behaviour_2 = Data(_01_doggy_behaviour)

# ---- group: DETERMINE ROBOT RETREAT / EXTENT PLANES
input_trackingpoint_3 = Point(rec_output_selectedpoint)
pt_albow_3 = Point(pt_albow)
bool_isincriclelimit_tooclose_3 = Data(bool_isincriclelimit_tooclose)
vec2pt = Vector2Pt(PointA=input_trackingpoint_3, PointB=pt_albow_3, Unitize=False)  # -> Vector, Length
rev = Reverse(Vector=vec2pt.Vector)
filter_3 = StreamFilter(Gate=bool_isincriclelimit_tooclose_3, Stream0=vec2pt.Vector, Stream1=rev)

float_roboretreat_3 = Data(float_roboretreat)
float_robotextent_3 = Data(float_robotextent)

input_trackingpoint_4 = Point(rec_output_selectedpoint)
pt_albow_4 = Point(pt_albow)
vec2pt_2 = Vector2Pt(PointA=input_trackingpoint_4, PointB=pt_albow_4, Unitize=False)  # -> Vector, Length
sph = Sphere(Base=pt_albow_4, Radius=float_robotextent_3)
bool_isincriclelimit_tooclose_4 = Data(bool_isincriclelimit_tooclose)
rev_2 = Reverse(Vector=vec2pt_2.Vector)
filter_4 = StreamFilter(Gate=bool_isincriclelimit_tooclose_4, Stream0=vec2pt_2.Vector, Stream1=rev_2)
project = ProjectPoint(Point=input_trackingpoint_4, Direction=filter_4, Geometry=sph)  # -> Point, Index
srf_cp = SurfaceClosestPoint(Point=project.Point, Surface=reparameterize(sph))  # -> Point, UVPoint, Distance
evalsrf = EvaluateSurface(Surface=reparameterize(sph), Point=srf_cp.UVPoint)  # -> Point, Normal, UDirection, VDirection, Frame
pln_roboextent = Data(evalsrf.Frame)

sph_2 = Sphere(Base=pt_albow_3, Radius=float_roboretreat_3)
project_2 = ProjectPoint(Point=input_trackingpoint_3, Direction=filter_3, Geometry=sph_2)  # -> Point, Index
srf_cp_2 = SurfaceClosestPoint(Point=project_2.Point, Surface=reparameterize(sph_2))  # -> Point, UVPoint, Distance
evalsrf_2 = EvaluateSurface(Surface=reparameterize(sph_2), Point=srf_cp_2.UVPoint)  # -> Point, Normal, UDirection, VDirection, Frame

pln_roboretreat = Data(evalsrf_2.Frame)

# ----
pln_roboretreat_2 = Data(pln_roboretreat)
pln_roboextent_2 = Data(pln_roboextent)

filter_5 = StreamFilter(Gate=_01_doggy_behaviour_2, Stream0=pln_roboretreat_2, Stream1=pln_roboextent_2)  # -> flatten(Stream)
target_2 = CreateTarget(Plane=filter_5, IsCartesian=True)
pln_robottarget = Data(target_2)

pln_robottarget_2 = Data(pln_robottarget)

K_2 = Kinematics(RobotSystem=input_robotsystem_2, Target=pln_robottarget_2, DisplayGeometry=_00_enable_to_check_if_script_working)  # -> Meshes, Joints, Planes, Errors
cull_i = CullIndex(List=K_2.Meshes, Indices=-1, Wrap=True)
sync_8 = SyncGeometry(Geometry=cull_i, DisplayMode=6)

# ---- group: ROBOT REACTION / ROBOT RETREAT
pln_roboretreat_3 = Data(pln_roboretreat)
transformto = TransformTo(Plane=pln_roboretreat_3, Relative=False)

# ---- group: ROBOT REACTION / ROBTO EXTE
pln_roboextent_3 = Data(pln_roboextent)
transformto_2 = TransformTo(Plane=pln_roboextent_3, Relative=False)

merge = Merge(Data1=speedto_2, Data2=transformto_2)

# ---- group: ROBOT REACTION / ROBOT RETREAT
merge_2 = Merge(Data1=speedto, Data2=transformto)

# ---- group: ROBOT REACTION
# 05
_01_doggy_behaviour_3 = Data(_01_doggy_behaviour)
filter_6 = StreamFilter(Gate=_01_doggy_behaviour_3, Stream0=merge_2, Stream1=merge)  # -> flatten(Stream)
detachtool = DetachTool()
merge_3 = Merge(Data1=detachtool, Data2=filter_6)  # -> flatten(Result)
_02_doggy_reaction = Data(merge_3)  # disabled

# ----
output_bridge_2 = Data(output_bridge)  # disabled
listen = Listen(Bridge=output_bridge_2, Autoupdate=True, Interval=66)  # disabled
actionexecuted = ActionExecuted(BridgeMessage=listen)  # -> LastAction, ActionTCP, ActionAxes, ActionExternalAxes, PendingActions, PendingActionsOnDevice; disabled
smaller_5 = SmallerThan(FirstNumber=actionexecuted.PendingActionsOnDevice, SecondNumber=0)  # -> SmallerThan, OrEqualTo; disabled
bool_buttonpressed = Boolean(input_startplaying)  # disabled
_02_doggy_reaction_2 = Data(_02_doggy_reaction)  # disabled
and = GateAnd(A=smaller_5.SmallerThan, B=bool_buttonpressed)  # disabled
send = Send(Bridge=output_bridge_2, Actions=_02_doggy_reaction_2, Send=and)  # -> Sent, Instructions; disabled
panel_4 = Panel(send.Instructions)  # disabled
panel_5 = Panel(send.Sent)  # disabled

# ==== cluster RelocateTxtPt
para_pointoffset = ClusterInput()
C = ClusterInput()
A = ClusterInput()
para_pointoffset_2 = Data(para_pointoffset)
end = EndPoints(Curve=C)  # -> Start, End
multiplication = Multiplication(A=A, B=para_pointoffset_2)
move = Move(Geometry=end.End, Motion=multiplication)  # -> Geometry, Transform
G = ClusterOutput(move.Geometry)
