# Grasshopper definition P03_Debug_RotationIssue.gh (Grasshopper 1.0.7)
# plug-ins: Robots

list = FlagFields({"Shoulder": 1, "Elbow": 2, "Wrist": 4}, selected="Shoulder")
input_robot_configuration_input = Data(list)

# ---- group: ROBOT TYPE
ip_address_ur10_blue = Panel("192.168.1.36")
input_ip_address = Data(ip_address_ur10_blue)

# ----
xy = XYPlane(Origin=Point(0, 0, 0))
input_robothomebase_pln = Data(xy)

list_2 = RobotsLibrary({"UR3e", "UR5e", "UR10e", "UR16e", "UR3", "UR5", "UR10"}, selected="UR10", Type=0)
input_robot_type_string = Data(list_2)

input_heightdifference_mm = Slider(-920, range=-1600..400)
input_jointpositiontoinvestigate_int = Slider(1, range=0..5)

input_pausecmd = Button()
input_playcmd = Button()
input_sentcmd = Button()
input_pausecmd_2 = Data(input_pausecmd)
input_playcmd_2 = Data(input_playcmd)
input_sentcmd_2 = Data(input_sentcmd)

input_robotstandardspeed_mm_s = Slider(30, range=0..250)
input_robotstandardspeed = Data(input_robotstandardspeed_mm_s)

input_heightdifferencefromhomeposition_0 = Data(input_heightdifference_mm)
input_jointpositiontoinvestigate_int_2 = Data(input_jointpositiontoinvestigate_int)

# ----
# USER INPUTS
# ROBOT BASE CONFIG
# 00
input_robotstandardspeed_2 = Data(input_robotstandardspeed)

input_robot_type_string_2 = Data(input_robot_type_string)
# 01
input_robothomebase_pln_2 = Data(input_robothomebase_pln)

loadrobot = LoadRobotSystem(Name=input_robot_type_string_2, Base=input_robothomebase_pln_2)
output_robottype = Data(loadrobot)

output_robottype_2 = Data(output_robottype)
input_heightdifferencefromhomeposition_0_2 = Data(input_heightdifferencefromhomeposition_0)

# ----
# DESIGN LABS
# AUTOMATIC INPUTS
# Parameters
speed = CreateSpeed(
    Translation=input_robotstandardspeed_2,
    Rotation=3.141592654,
    ExternalTranslation=5000,
    ExternalRotation=18.84955592,
    AccelTranslation=2500,
    AccelAxis=12.56637061)
# HELPERS
input_robotstandardspeed_3 = Data(speed)

# ----
# Established TCP
loy_tcp_plane = LOY_TCPPlane(output_robottype=output_robottype_2, input_heightdifferencefromhomeposition_0=input_heightdifferencefromhomeposition_0_2)
output_establishedplane_pln = Data(loy_tcp_plane)

output_establishedplane_pln_2 = Data(output_establishedplane_pln)
input_robot_configuration_input_2 = Data(input_robot_configuration_input)
input_robotstandardspeed_4 = Data(input_robotstandardspeed_3)

pl_offset = PlaneOffset(BasePlane=output_establishedplane_pln_2, Offset=300)
target = CreateTarget(
    Plane=[output_establishedplane_pln_2, pl_offset],
    RobConf=input_robot_configuration_input_2,
    Speed=input_robotstandardspeed_4,
    IsCartesian=True)
output_establishedtarget_robot = Data(target)

# ----
# 02
output_establishedtarget_robot_2 = Data(graft(output_establishedtarget_robot))
# PROCESSING FUNCTIONS
# THINGS TO INVESTIGATE
# 01
output_robottype_3 = Data(output_robottype)

# ----
# MAIN FUNCTION
# Robot Kinematics
K = Kinematics(RobotSystem=output_robottype_3, Target=output_establishedtarget_robot_2, DisplayGeometry=True)  # -> Meshes, Joints, Planes, Errors
# UI / OUTPUTS
output_robotjoint_anglevalue = Data(simplify(K.Joints))
output_robotjoint_plane = Data(simplify(K.Planes))

output_robotjoint_plane_2 = Data(output_robotjoint_plane)

output_robotjoint_anglevalue_2 = Data(output_robotjoint_anglevalue)

# ----
# Robot Kinematics_Investigation
loy_robotplane = LOY_RobotPlane(V=output_robotjoint_plane_2)  # -> output_locationplane_2, output_robotskeleton_2
output_robotskeleton = Data(loy_robotplane.output_robotskeleton_2)
output_locationplane = Data(loy_robotplane.output_locationplane_2)

loy_robotangularjoint = LOY_RobotAngularJoint(T=output_robotjoint_anglevalue_2)
output_degree_number = Data(loy_robotangularjoint)

output_locationplane_2 = Data(output_locationplane)
output_degree_number_2 = Data(output_degree_number)
input_jointpositiontoinvestigate_int_3 = Data(input_jointpositiontoinvestigate_int_2)

loy_tagging = LOY_Tagging(
    output_locationplane=output_locationplane_2,
    output_degree_number=output_degree_number_2,
    input_jointpositiontoinvestigate_int=input_jointpositiontoinvestigate_int_3)  # -> P, s_0
tag = TextTag(Location=loy_tagging.P, Text=loy_tagging.s_0)

# ----
# SENT ROBOT PROGRAMME
# 00
panel = Panel("LOY_Demo_AngularLimitation")
output_robottype_4 = Data(output_robottype)
output_establishedtarget_robot_3 = Data(output_establishedtarget_robot)

# ----
# Create Robot Cmd & Sent It
program = CreateProgram(Name=panel, RobotSystem=output_robottype_4, Targets=output_establishedtarget_robot_3, StepSize=1)  # -> Program, Code, Duration, Warnings, Errors
input_programme = Data(program.Program)

input_playcmd_3 = Data(input_playcmd_2)
input_pausecmd_3 = Data(input_pausecmd_2)
input_programme_2 = Data(input_programme)
input_ip_address_2 = Data(input_ip_address)
input_sentcmd_3 = Data(input_sentcmd_2)

input_programme_3 = Data(input_programme)
sim = ProgramSimulation(Program=input_programme_3, Time=0, Normalized=True)  # -> SystemMeshes, JointRotations, Plane, Index, Time, Program, Errors

remote = RemoteConnection(Program=input_programme_2, IP=input_ip_address_2, Upload=input_sentcmd_3, Play=input_playcmd_3, Pause=input_pausecmd_3)
panel_2 = Panel(remote)

# ==== cluster LOY_RobotPlane
V = ClusterInput()
pline = PolyLine(Vertices=V, Closed=False)
explode = Explode(Curve=pline, Recursive=True)  # -> Segments, Vertices
end = EndPoints(Curve=explode.Segments)  # -> simplify(Start), End
output_robotskeleton = Data(pline)
output_locationplane = Data(end.Start)
output_locationplane_2 = ClusterOutput(output_locationplane)
output_robotskeleton_2 = ClusterOutput(output_robotskeleton)

# ==== cluster LOY_RobotAngularJoint
T = ClusterInput()
split = TextSplit(Text=T, Separators=",")
deg = Degrees(Radians=split)  # -> simplify(Degrees)
output_degree_number = Data(deg)
panel = Panel(deg)
output_degree_number_2 = ClusterOutput(output_degree_number)

# ==== cluster LOY_TCPPlane
output_robottype = ClusterInput()
input_heightdifferencefromhomeposition_0 = ClusterInput()
input_jose_homeposition = Data(["0", "-90", "-90", "-90", "90", "90"])
output_robottype_2 = Data(output_robottype)
input_heightdifferencefromhomeposition_0_2 = Data(input_heightdifferencefromhomeposition_0)
degtorad = DegreesToRadians(Degrees=input_jose_homeposition, RobotSystem=output_robottype_2, MechanicalGroup=0)
target = CreateTarget(Joints=degtorad, IsCartesian=False)
K = Kinematics(RobotSystem=output_robottype_2, Target=target, DisplayGeometry=False)  # -> Meshes, Joints, Planes, Errors
Z = UnitZ(Factor=input_heightdifferencefromhomeposition_0_2)
item = ListItem(List=K.Planes, Index=-1, Wrap=True)
move = Move(Geometry=item, Motion=Z)  # -> Geometry, Transform
output_establishedplane_pln = Data(move.Geometry)
output_establishedplane_pln_2 = ClusterOutput(output_establishedplane_pln)

# ==== cluster LOY_Tagging
input_jointpositiontoinvestigate_int = ClusterInput()
output_degree_number = ClusterInput()
output_locationplane = ClusterInput()
input_jointpositiontoinvestigate_int_2 = Data(input_jointpositiontoinvestigate_int)
output_degree_number_2 = Data(output_degree_number)
output_locationplane_2 = Data(output_locationplane)
item = ListItem(List=output_locationplane_2, Index=input_jointpositiontoinvestigate_int_2, Wrap=True)  # -> flatten(Item)
item_2 = ListItem(List=output_degree_number_2, Index=input_jointpositiontoinvestigate_int_2, Wrap=True)
roundd = RoundToDecimalPlace(NumberX=item_2, DecimalPlace=1, RoundType=0)  # -> Rounded, Difference
cullpt = CullDuplicates(Points=item, Tolerance=0.1, CullMode=3)  # -> flatten(Points), Indices, Valence
dispatch = Dispatch(List=flatten(roundd.Rounded), DispatchPattern=[True, False])  # -> ListA, ListB
P = ClusterOutput(cullpt.Points)
concat = Concatenate(FragmentA=dispatch.ListA, FragmentB=" & ", FragmentC=dispatch.ListB)
null = NullItem(Item=dispatch.ListB)  # -> NullFlags, InvalidFlags, Description
filter = StreamFilter(Gate=null.NullFlags, Stream0=concat, Stream1=dispatch.ListA)
s_0 = ClusterOutput(filter)
