# Grasshopper definition P05_WorkshopInduction.gh (Grasshopper 1.0.7)
# plug-ins: Fologram for Grasshopper, Fologram For Grasshopper Utilities, Robots, Heteroptera, Pufferfish

input_planeoffsetdistance = Slider(150, range=0..1000)
input_rotationangle = Slider(55, range=0..360)
input_planeroundedradius = Slider(50, range=0..100)
input_interfaceoffsetdistance = Slider(10, range=0..100)
input_rotationangle_2 = Data(input_rotationangle)
input_planeoffsetdistance_2 = Data(input_planeoffsetdistance)
input_planeroundedradius_2 = Data(input_planeroundedradius)
input_interfaceoffsetdistance_2 = Data(input_interfaceoffsetdistance)

d_induction01 = Slider(600, range=0..1000)  # disabled
# USER INPUTS
# INDUCTION SPACE
# 01
d_workstation = Slider(700, range=0..10000)  # disabled
d_induction02 = Slider(800, range=0..1000)  # disabled
d_induction03 = Slider(900, range=0..1000)  # disabled
d_induction04 = Slider(2700, range=0..10000)

d_inductiondepth = Slider(1200, range=0..10000)

# ----
# DESIGN LABS
# AUTOMATIC INPUTS
# Established Space Requirement
merge = Merge(Data1=d_workstation, Data2=d_induction01, Data3=d_induction02, Data4=d_induction03, Data5=d_induction04)  # disabled
loy_boundary = LOY_Boundary(I=merge, Y=d_inductiondepth)  # disabled
crv_boundarygeomery = Data(loy_boundary)  # disabled

crv_boundarygeomery_2 = Data([{Plane=PlaneXY(0, 0, 0), Size=Domain2(u=0..700, v=0..1200)}, {Plane=PlaneXY(0, 0, 0), Size=Domain2(u=700..1300, v=0..1200)}, {Plane=PlaneXY(0, 0, 0), Size=Domain2(u=1300..2100, v=0..1200)}, {Plane=PlaneXY(0, 0, 0), Size=Domain2(u=2100..3000, v=0..1200)}, {Plane=PlaneXY(0, 0, 0), Size=Domain2(u=3000..5700, v=0..1200)}])

crv_boundarygeomery_3 = Data(crv_boundarygeomery_2)
sync = SyncGeometry(Geometry=crv_boundarygeomery_3)

event = EventType(8)
hands = GetHands(Event=event, Left=Toggle(False), outputAllData=False)
hand = DeconstructHand(Hand=hands)  # -> Device, Points, Left
cluster = Cluster_3(L=hand.Points)

cluster_2 = Cluster_2(input_pinchpoint=cluster)

cluster_3 = Cluster(input_pinchpoint=cluster)  # -> G, number_slider
text_dot = ConstructTextDot(Text="Right Hand", Point=cluster_3.G, Size=cluster_3.number_slider)
output_textanno = Data(text_dot)

input_titlefontsize = Slider(32, range=0..100)
input_titlerow_bottomup = Slider(10, range=0..100)
input_titlerow_bottomup_2 = Data(input_titlerow_bottomup)
input_titlefontsize_2 = Data(input_titlefontsize)
# MAIN FUNCTION
# UI / OUTPUTS
input_titlename = Data("Induction 01")

panel = Panel("""Pinch within the box, 
sphere will appear.""")
input_inductiontextrow_bottomup = Slider(5, range=0..10)
input_inductionfontsize = Slider(16, range=0..100)
input_inductiontextrow_bottomup_2 = Data(input_inductiontextrow_bottomup)
input_inductionfontsize_2 = Data(input_inductionfontsize)
input_inudctiontext = Data(panel)

input_width_mm = Slider(172, range=0..10000)
input_height_mm = Slider(100, range=0..10000)
dom = ConstructDomain(DomainStart=expr("-X", input_width_mm), DomainEnd=input_width_mm)
dom_2 = ConstructDomain(DomainStart=expr("-X", input_height_mm), DomainEnd=input_height_mm)
input_height_mm_2 = Data(dom_2)
input_width_mm_2 = Data(dom)

input_interfacedivision = Slider(11, range=0..100)
input_interfacedivision_2 = Data(input_interfacedivision)

input_meshsphere = Data(cluster_2)
output_textanno_2 = Data(output_textanno)
merge_2 = Merge(Data1=input_meshsphere, Data2=output_textanno_2)
sync_2 = SyncGeometry(Geometry=merge_2)  # disabled

# ----
# PROCESSING FUNCTIONS
# HELPERS
# INDUCTION 01
crv_boundarygeomery_4 = Data(crv_boundarygeomery_2)

input_boxheight = Slider(1200, range=0..10000)
Z = UnitZ(Factor=input_boxheight)

crv_boundarygeomery_5 = Data(crv_boundarygeomery_4)
item = ListItem(List=crv_boundarygeomery_5, Index=1, Wrap=True)

debrep = DeconstructBrep(Brep=item)  # -> Faces, Edges, Vertices
input_basesurface = Data(debrep.Faces)
input_baseedges = Data(debrep.Edges)

input_rotationangle_3 = Data(input_rotationangle_2)
input_planeoffsetdistance_3 = Data(input_planeoffsetdistance_2)
input_planeroundedradius_3 = Data(input_planeroundedradius_2)
input_height_mm_3 = Data(input_height_mm_2)
input_baseedges_2 = Data(input_baseedges)
input_width_mm_3 = Data(input_width_mm_2)

input_basesurface_2 = Data(input_basesurface)

establishedguidebase = EstablishedGuideBase(
    input_baseedges=input_baseedges_2,
    input_rotationangle=input_rotationangle_3,
    input_planeoffsetdistance=input_planeoffsetdistance_3,
    input_planeroundedradius=input_planeroundedradius_3,
    input_width_mm=input_width_mm_3,
    input_height_mm=input_height_mm_3)  # -> output_guideplane_2, output_guidesurface_2, output_guideoutline_2
output_guidesurface = Data(establishedguidebase.output_guidesurface_2)
output_guideoutline = Data(establishedguidebase.output_guideoutline_2)
output_guideplane = Data(establishedguidebase.output_guideplane_2)

output_guideoutline_2 = Data(output_guideoutline)
output_guideplane_2 = Data(output_guideplane)
input_interfacedivision_3 = Data(input_interfacedivision_2)
input_interfaceoffsetdistance_3 = Data(input_interfaceoffsetdistance_2)
output_guidesurface_2 = Data(output_guidesurface)
input_titlerow_bottomup_3 = Data(input_titlerow_bottomup_2)
input_inductiontextrow_bottomup_3 = Data(input_inductiontextrow_bottomup_2)

establishtargetposition = EstablishTargetPosition(
    output_guideoutline=output_guideoutline_2,
    input_interfaceoffsetdistance=input_interfaceoffsetdistance_3,
    output_guidesurface=output_guidesurface_2,
    output_guideplane=output_guideplane_2,
    input_interfacedivision=input_interfacedivision_3,
    input_titlerow_bottomup=input_titlerow_bottomup_3,
    input_inductiontextrow_bottomup=input_inductiontextrow_bottomup_3)  # -> output_interfaceinnercrv_2, output_titleplane_2, output_textplane_2
output_titleplane = Data(establishtargetposition.output_titleplane_2)
output_interfaceinnercrv = Geometry(establishtargetposition.output_interfaceinnercrv_2)
output_textplane = Data(establishtargetposition.output_textplane_2)

extr = Extrude(Base=input_basesurface_2, Direction=Z)
cap = CapHoles(Brep=extr)
output_boundarycollision = Data(cap)

input_zoning = Data(output_boundarycollision)
cluster_4 = Cluster_4(input_zoning=input_zoning, input_zoningnumber=Slider(0, range=0..3), input_pinchpoint=cluster)
T = StateGate(States=cluster_4, LinkTarget=sync_2)  # -> True, False

hands_2 = GetHands(Event=event, Left=Toggle(True), outputAllData=False)
hand_2 = DeconstructHand(Hand=hands_2)  # -> Device, Points, Left
cluster_5 = Cluster_3(L=hand_2.Points)

cluster_6 = Cluster_2(input_pinchpoint=cluster_5)

cluster_7 = Cluster(input_pinchpoint=cluster_5)  # -> G, number_slider
text_dot_2 = ConstructTextDot(Text="Left Hand", Point=cluster_7.G, Size=cluster_7.number_slider)
output_textanno_3 = Data(text_dot_2)

input_meshsphere_2 = Data(cluster_6)
output_textanno_4 = Data(output_textanno_3)
merge_3 = Merge(Data1=input_meshsphere_2, Data2=output_textanno_4)
sync_3 = SyncGeometry(Geometry=merge_3)  # disabled

input_zoning_2 = Data(output_boundarycollision)
cluster_8 = Cluster_4(input_zoning=input_zoning_2, input_zoningnumber=Slider(0, range=0..3), input_pinchpoint=cluster_5)
T_2 = StateGate(States=cluster_8, LinkTarget=sync_3)  # -> True, False

output_guideoutline_3 = Data(output_guideoutline)
output_interfaceinnercrv_2 = Geometry(output_interfaceinnercrv)

output_titleplane_2 = Data(output_titleplane)
input_titlefontsize_3 = Data(input_titlefontsize_2)
input_titlename_2 = Data(input_titlename)

output_textplane_2 = Data(output_textplane)
input_inudctiontext_2 = Data(input_inudctiontext)
input_inductionfontsize_3 = Data(input_inductionfontsize_2)

output_guidesurface_3 = Data(output_guidesurface)

display = DisplayMode(4)

output_boundarycollision_2 = Data(output_boundarycollision)
sync_4 = SyncGeometry(Geometry=output_boundarycollision_2, Material=ColourSwatch(SwatchColor=RGBA(255, 255, 255, 7)), DisplayMode=display)

text_entity = ConstructTextEntity(
    Text=input_titlename_2,
    Plane=output_titleplane_2,
    Size=input_titlefontsize_3,
    TextHorizontalAlignment=1,
    TextVerticalAlignment=3)
text_entity_2 = ConstructTextEntity(
    Text=input_inudctiontext_2,
    Plane=output_textplane_2,
    Size=input_inductionfontsize_3,
    TextHorizontalAlignment=1,
    TextVerticalAlignment=3)

sync_5 = SyncGeometry(Geometry=output_guidesurface_3, Material=ColourSwatch(SwatchColor=RGBA(64, 64, 64, 27)))

merge_4 = Merge(
    Data1=flatten(output_interfaceinnercrv_2),
    Data2=flatten(output_guideoutline_3),
    Data3=flatten(text_entity),
    Data4=flatten(text_entity_2))
sync_6 = SyncGeometry(Geometry=merge_4)

# ----
# INDUCTION 02
crv_boundarygeomery_6 = Data(crv_boundarygeomery_2)

input_titlefontsize_4 = Slider(32, range=0..100)
input_titlerow_bottomup_4 = Slider(10, range=0..100)
input_titlerow_bottomup_5 = Data(input_titlerow_bottomup_4)
input_titlefontsize_5 = Data(input_titlefontsize_4)
input_titlename_3 = Data("Induction 02")

input_inductiontextrow_bottomup_4 = Slider(5, range=0..10)
input_inductionfontsize_4 = Slider(16, range=0..100)
input_inductiontextrow_bottomup_5 = Data(input_inductiontextrow_bottomup_4)
input_inductionfontsize_5 = Data(input_inductionfontsize_4)
input_inudctiontext_3 = Data("Pinch the buttons")

input_width_mm_4 = Slider(172, range=0..10000)
input_height_mm_4 = Slider(100, range=0..10000)
dom_3 = ConstructDomain(DomainStart=expr("-X", input_width_mm_4), DomainEnd=input_width_mm_4)
dom_4 = ConstructDomain(DomainStart=expr("-X", input_height_mm_4), DomainEnd=input_height_mm_4)
input_height_mm_5 = Data(dom_4)
input_width_mm_5 = Data(dom_3)

input_interfacedivision_4 = Slider(11, range=0..100)
input_interfacedivision_5 = Data(input_interfacedivision_4)

input_boxheight_2 = Slider(1200, range=0..10000)
Z_2 = UnitZ(Factor=input_boxheight_2)

headset_name = Data("HOLOLENS-CV9UEE")
devices = GetDevices(Event=2, Headset=Toggle(True), outputAllData=False)
device = DeconstructDevice(Device=devices)  # -> Plane, Name, Type
expression = Expression(x=device.Name, y=headset_name, Expression="if(x=y,true,false)")
cull = CullPattern(List=devices, CullPattern=expression)
pt_headsetlocation = Data(cull)

xy = XYPlane(Origin=Point(0, 0, 0))
base_plane = Data(xy)

geo_upbutton = Geometry(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)
geo_downbutton = Geometry(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)
geo_resetbutton = Geometry(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)

input_standardcolorswatch = Data(ColourSwatch(SwatchColor=RGB(255, 147, 38)))
input_resetcolorswatch = Data(ColourSwatch(SwatchColor=RGB(255, 69, 69)))

input_font_size = Slider(20, range=0..100)
input_fontsize = Data(input_font_size)

crv_boundarygeomery_7 = Data(crv_boundarygeomery_6)
item_2 = ListItem(List=crv_boundarygeomery_7, Index=2, Wrap=True)

debrep_2 = DeconstructBrep(Brep=item_2)  # -> Faces, Edges, Vertices
input_basesurface_3 = Data(debrep_2.Faces)
input_baseedges_3 = Data(debrep_2.Edges)

input_baseedges_4 = Data(input_baseedges_3)
input_rotationangle_4 = Data(input_rotationangle_2)
input_planeoffsetdistance_4 = Data(input_planeoffsetdistance_2)
input_planeroundedradius_4 = Data(input_planeroundedradius_2)
input_width_mm_6 = Data(input_width_mm_5)
input_height_mm_6 = Data(input_height_mm_5)

pt_headsetlocation_2 = Point(pt_headsetlocation)
null = NullItem(Item=pt_headsetlocation_2)  # -> NullFlags, InvalidFlags, Description
filter = StreamFilter(Gate=null.NullFlags, Stream0=pt_headsetlocation_2, Stream1=Point(0, 0, 0))
input_basesurface_4 = Data(debrep_2.Faces)
pdecon = Deconstruct(Point=filter)  # -> XComponent, YComponent, ZComponent
roundf = RoundToFactor(NumberX=pdecon.ZComponent, Factor=Slider(100, range=0..100), RoundType="1")  # -> Rounded, Difference, MultiplierR, MultiplierX
area = Area(Geometry=input_basesurface_4)  # -> Area, Centroid
subtraction = Subtraction(A=roundf.Rounded, B=450)
pdecon_2 = Deconstruct(Point=area.Centroid)  # -> XComponent, YComponent, ZComponent
null_2 = NullItem(Item=pt_headsetlocation_2)  # -> NullFlags, InvalidFlags, Description
filter_2 = StreamFilter(Gate=null_2.NullFlags, Stream0=subtraction, Stream1="0")
pt = ConstructPoint(XCoordinate=pdecon_2.XComponent, YCoordinate=pdecon_2.YComponent, ZCoordinate=filter_2)
xy_2 = XYPlane(Origin=pt)
output_adjustedheightxyplane = Data(xy_2)

input_basesurface_5 = Data(input_basesurface_3)

establishedguidebase_2 = EstablishedGuideBase(
    input_baseedges=input_baseedges_4,
    input_rotationangle=input_rotationangle_4,
    input_planeoffsetdistance=input_planeoffsetdistance_4,
    input_planeroundedradius=input_planeroundedradius_4,
    input_width_mm=input_width_mm_6,
    input_height_mm=input_height_mm_6)  # -> output_guideplane_2, output_guidesurface_2, output_guideoutline_2
output_guidesurface_4 = Data(establishedguidebase_2.output_guidesurface_2)
output_guideoutline_4 = Data(establishedguidebase_2.output_guideoutline_2)
output_guideplane_3 = Data(establishedguidebase_2.output_guideplane_2)

output_guideoutline_5 = Data(output_guideoutline_4)
input_interfaceoffsetdistance_4 = Data(input_interfaceoffsetdistance_2)
output_guidesurface_5 = Data(output_guidesurface_4)
output_guideplane_4 = Data(output_guideplane_3)
input_interfacedivision_6 = Data(input_interfacedivision_5)
input_titlerow_bottomup_6 = Data(input_titlerow_bottomup_5)
input_inductiontextrow_bottomup_6 = Data(input_inductiontextrow_bottomup_5)

establishtargetposition_2 = EstablishTargetPosition(
    output_guideoutline=output_guideoutline_5,
    input_interfaceoffsetdistance=input_interfaceoffsetdistance_4,
    output_guidesurface=output_guidesurface_5,
    output_guideplane=output_guideplane_4,
    input_interfacedivision=input_interfacedivision_6,
    input_titlerow_bottomup=input_titlerow_bottomup_6,
    input_inductiontextrow_bottomup=input_inductiontextrow_bottomup_6)  # -> output_interfaceinnercrv_2, output_titleplane_2, output_textplane_2
output_interfaceinnercrv_3 = Geometry(establishtargetposition_2.output_interfaceinnercrv_2)
output_titleplane_3 = Data(establishtargetposition_2.output_titleplane_2)
output_textplane_3 = Data(establishtargetposition_2.output_textplane_2)

output_adjustedheightxyplane_2 = Data(output_adjustedheightxyplane)
input_standardcolorswatch_2 = Data(input_standardcolorswatch)
geo_upbutton_2 = Geometry(geo_upbutton)
base_plane_2 = Data(base_plane)

output_adjustedheightxyplane_3 = Data(output_adjustedheightxyplane)
input_standardcolorswatch_3 = Data(input_standardcolorswatch)
geo_downbutton_2 = Geometry(geo_downbutton)
base_plane_3 = Data(base_plane)

output_adjustedheightxyplane_4 = Data(output_adjustedheightxyplane)
input_resetcolorswatch_2 = Data(input_resetcolorswatch)
geo_resetbutton_2 = Geometry(geo_resetbutton)
base_plane_4 = Data(base_plane)

extr_2 = Extrude(Base=input_basesurface_5, Direction=Z_2)
cap_2 = CapHoles(Brep=extr_2)
output_boundarycollision_3 = Data(cap_2)

orient = Orient(Geometry=geo_upbutton_2, Source=base_plane_2, Target=output_adjustedheightxyplane_2)  # -> Geometry, Transform
sync_7 = SyncGeometry(Geometry=orient.Geometry, Material=input_standardcolorswatch_2, Interactions=1)

orient_2 = Orient(Geometry=geo_downbutton_2, Source=base_plane_3, Target=output_adjustedheightxyplane_3)  # -> Geometry, Transform
sync_8 = SyncGeometry(Geometry=orient_2.Geometry, Material=input_standardcolorswatch_3, Interactions=1)

orient_3 = Orient(Geometry=geo_resetbutton_2, Source=base_plane_4, Target=output_adjustedheightxyplane_4)  # -> Geometry, Transform
sync_9 = SyncGeometry(Geometry=orient_3.Geometry, Material=input_resetcolorswatch_2, Interactions=1)

merge_5 = Merge(Data1=flatten(orient.Geometry), Data2=flatten(orient_2.Geometry), Data3=flatten(orient_3.Geometry))
bbox = BoundingBox(Content=merge_5, Plane=PlaneXY(0, 0, 0), UnionBox=True)  # -> Box, Box_2
output_generallocation = Data(bbox.Box)

output_generallocation_2 = Data(output_generallocation)

output_generallocation_3 = Data(output_generallocation)
number_slider = Slider(3, range=0..100)

box = EvaluateBox(Box=output_generallocation_3, UParameter=0.5, VParameter=number_slider, WParameter=number_slider)  # -> Plane, Point, Include
output_locationofmenu = Data(box.Point)

neg = Negative(Value=Slider(2, range=0..10))
box_2 = EvaluateBox(Box=output_generallocation_2, UParameter=0.5, VParameter=neg, WParameter=0)  # -> Plane, Point, Include

cyl = Cylinder(Base=box_2.Plane, Radius=Slider(40, range=0..100), Length=Slider(51, range=0..100))
cap_3 = CapHoles(Brep=cyl)
geo_button = Data(cap_3)

tap = OnTap(SyncGeometry=sync_7)  # -> Enabled, Interactor
T_3 = StateGate(States=tap.Enabled, LinkTarget=toggle_up)

tap_2 = OnTap(SyncGeometry=sync_8)  # -> Enabled, Interactor
T_4 = StateGate(States=tap_2.Enabled, LinkTarget=toggle_bottom)

tap_3 = OnTap(SyncGeometry=sync_9)  # -> Enabled, Interactor
T_5 = StateGate(States=tap_3.Enabled, LinkTarget=toggle_reset)

interaction = InteractionType(1)
geo_button_2 = Data(geo_button)

geo_button_3 = Data(geo_button)

bbox_2 = BoundingBox(Content=geo_button_3, Plane=PlaneXY(0, 0, 0))  # -> Box, Box_2
box_3 = EvaluateBox(Box=bbox_2.Box, UParameter=0.5, VParameter=0.5, WParameter=2)  # -> Plane, Point, Include

text_dot_3 = ConstructTextDot(Text="Tap to turn on/off visibility of the counter", Point=box_3.Plane, Size=Slider(15, range=0..100))
sync_10 = SyncGeometry(Geometry=text_dot_3)

# ---- group: COUNT THE ITEM TO PREVIEW
toggle_up = BooleanToggle(True)  # disabled
toggle_bottom = BooleanToggle(True)  # disabled
toggle_reset = BooleanToggle(True)  # disabled
C = Counter(Trigger=toggle_up, Reset=toggle_reset)
C_2 = Counter(Trigger=toggle_bottom, Reset=toggle_reset)
neg_2 = Negative(Value=C_2)
addition = Addition(A=C, B=neg_2)
division = Division(A=addition, B=2)
txt_result = Text(division)

# ----
output_interfaceinnercrv_4 = Geometry(output_interfaceinnercrv_3)
output_guideoutline_6 = Data(output_guideoutline_4)

input_titlename_4 = Data(input_titlename_3)
output_titleplane_4 = Data(output_titleplane_3)
input_titlefontsize_6 = Data(input_titlefontsize_5)

output_textplane_4 = Data(output_textplane_3)
input_inductionfontsize_6 = Data(input_inductionfontsize_5)
input_inudctiontext_4 = Data(input_inudctiontext_3)

output_guidesurface_6 = Data(output_guidesurface_4)

sync_11 = SyncGeometry(Geometry=geo_button_2, Material=ColourSwatch(SwatchColor=RGB(219, 193, 224)), Interactions=interaction)
toggle = OnToggle(SyncGeometry=sync_11)  # -> Enabled, Interactor
T_6 = StateGate(States=toggle.Enabled, LinkTarget=sync_13)

text_entity_3 = ConstructTextEntity(
    Text=input_titlename_4,
    Plane=output_titleplane_4,
    Size=input_titlefontsize_6,
    TextHorizontalAlignment=1,
    TextVerticalAlignment=3)
text_entity_4 = ConstructTextEntity(
    Text=input_inudctiontext_4,
    Plane=output_textplane_4,
    Size=input_inductionfontsize_6,
    TextHorizontalAlignment=1,
    TextVerticalAlignment=3)

sync_12 = SyncGeometry(Geometry=output_guidesurface_6, Material=ColourSwatch(SwatchColor=RGBA(64, 64, 64, 27)))

output_locationofmenu_2 = Data(output_locationofmenu)
input_fontsize_2 = Data(input_fontsize)
txt_result_2 = Text(txt_result)
text_dot_4 = ConstructTextDot(Text=txt_result_2, Point=output_locationofmenu_2, Size=input_fontsize_2)
sync_13 = SyncGeometry(Geometry=text_dot_4)  # disabled

merge_6 = Merge(
    Data1=flatten(output_interfaceinnercrv_4),
    Data2=flatten(output_guideoutline_6),
    Data3=flatten(text_entity_3),
    Data4=flatten(text_entity_4))
sync_14 = SyncGeometry(Geometry=merge_6)

event_2 = EventType(4)
qr = GetQRCodes(Event=event_2, outputAllData=False)
qr_2 = DeconstructQRCode(QRCode=qr)  # -> Device, Rectangle, Label, Age

input_ur10_base = Data(Plane(origin=(2550, 500, 127.3), x=(-1, 0, 0), y=(0, 0, -1)))

input_woodendowellength = Slider(300, range=0..300)
division_2 = Division(A=input_woodendowellength, B="2")
input_lengthparameter = Data(division_2)

input_titlefontsize_7 = Slider(32, range=0..100)
input_titlerow_bottomup_7 = Slider(10, range=0..100)
input_titlerow_bottomup_8 = Data(input_titlerow_bottomup_7)
input_titlefontsize_8 = Data(input_titlefontsize_7)
input_titlename_5 = Data("Induction 03")

input_inductiontextrow_bottomup_7 = Slider(5, range=0..10)
panel_2 = Panel("""Using the QR Code to place robot TCP.
Pinch to confirm to robot location.""")
input_inductionfontsize_7 = Slider(12, range=0..100)
input_inductiontextrow_bottomup_8 = Data(input_inductiontextrow_bottomup_7)
input_inductionfontsize_8 = Data(input_inductionfontsize_7)
input_inudctiontext_5 = Data(panel_2)

input_width_mm_7 = Slider(172, range=0..10000)
input_height_mm_7 = Slider(100, range=0..10000)
dom_5 = ConstructDomain(DomainStart=expr("-X", input_width_mm_7), DomainEnd=input_width_mm_7)
dom_6 = ConstructDomain(DomainStart=expr("-X", input_height_mm_7), DomainEnd=input_height_mm_7)
input_height_mm_8 = Data(dom_6)
input_width_mm_8 = Data(dom_5)

input_interfacedivision_7 = Slider(11, range=0..100)
input_interfacedivision_8 = Data(input_interfacedivision_7)

# ----
# INDUCTION 03
crv_boundarygeomery_8 = Data(crv_boundarygeomery_2)

input_boxheight_3 = Slider(1200, range=0..10000)
Z_3 = UnitZ(Factor=input_boxheight_3)

input_maximumoperationalrange = Slider(1300, range=0..10000)
input_maximumoperationalrange_2 = Data(input_maximumoperationalrange)

crv_boundarygeomery_9 = Data(crv_boundarygeomery_8)
item_3 = ListItem(List=crv_boundarygeomery_9, Index=3, Wrap=True)

expression_2 = Expression(x=qr_2.Label, y="W01", Expression="if(x=y,true,false)")
cull_2 = CullPattern(List=qr, CullPattern=expression_2)
input_qrgeometry = Rectangle(cull_2)
input_qrplane = Plane(cull_2)

input_maximumoperationalrange_3 = Data(input_maximumoperationalrange_2)
input_lengthparameter_2 = Data(input_lengthparameter)
input_qrgeometry_2 = Rectangle(input_qrgeometry)
input_qrplane_2 = Plane(input_qrplane)
input_ur10_base_2 = Data(input_ur10_base)

cluster_9 = Cluster_5(
    input_qrplane=input_qrplane_2,
    input_qrgeometry=input_qrgeometry_2,
    input_lengthparameter=input_lengthparameter_2,
    input_maximumoperationalrange=input_maximumoperationalrange_3,
    input_ur10_base=input_ur10_base_2)  # -> output_qrcodeplane_2, output_robottarget_2, output_showorhide_2
output_qrcodeplane = Data(cluster_9.output_qrcodeplane_2)
output_robottarget = Data(cluster_9.output_robottarget_2)
output_showorhide = Data(cluster_9.output_showorhide_2)

debrep_3 = DeconstructBrep(Brep=item_3)  # -> Faces, Edges, Vertices
input_basesurface_6 = Data(debrep_3.Faces)
input_baseedges_5 = Data(debrep_3.Edges)

input_basesurface_7 = Data(input_basesurface_6)
list = RobotsLibrary({"UR3e", "UR5e", "UR10e", "UR16e", "UR3", "UR5", "UR10"}, selected="UR10", Type=0)

input_rotationangle_5 = Data(input_rotationangle_2)
input_planeroundedradius_5 = Data(input_planeroundedradius_2)
input_baseedges_6 = Data(input_baseedges_5)
input_planeoffsetdistance_5 = Data(input_planeoffsetdistance_2)
input_width_mm_9 = Data(input_width_mm_8)
input_height_mm_9 = Data(input_height_mm_8)

area_2 = Area(Geometry=input_basesurface_7)  # -> Area, Centroid
xy_3 = XYPlane(Origin=area_2.Centroid)

input_basesurface_8 = Data(input_basesurface_6)

establishedguidebase_3 = EstablishedGuideBase(
    input_baseedges=input_baseedges_6,
    input_rotationangle=input_rotationangle_5,
    input_planeoffsetdistance=input_planeoffsetdistance_5,
    input_planeroundedradius=input_planeroundedradius_5,
    input_width_mm=input_width_mm_9,
    input_height_mm=input_height_mm_9)  # -> output_guideplane_2, output_guidesurface_2, output_guideoutline_2
output_guidesurface_7 = Data(establishedguidebase_3.output_guidesurface_2)
output_guideoutline_7 = Data(establishedguidebase_3.output_guideoutline_2)
output_guideplane_5 = Data(establishedguidebase_3.output_guideplane_2)

output_guideoutline_8 = Data(output_guideoutline_7)
input_interfaceoffsetdistance_5 = Data(input_interfaceoffsetdistance_2)
output_guidesurface_8 = Data(output_guidesurface_7)
output_guideplane_6 = Data(output_guideplane_5)
input_interfacedivision_9 = Data(input_interfacedivision_8)
input_titlerow_bottomup_9 = Data(input_titlerow_bottomup_8)
input_inductiontextrow_bottomup_9 = Data(input_inductiontextrow_bottomup_8)

establishtargetposition_3 = EstablishTargetPosition(
    output_guideoutline=output_guideoutline_8,
    input_interfaceoffsetdistance=input_interfaceoffsetdistance_5,
    output_guidesurface=output_guidesurface_8,
    output_guideplane=output_guideplane_6,
    input_interfacedivision=input_interfacedivision_9,
    input_titlerow_bottomup=input_titlerow_bottomup_9,
    input_inductiontextrow_bottomup=input_inductiontextrow_bottomup_9)  # -> output_interfaceinnercrv_2, output_titleplane_2, output_textplane_2
output_titleplane_5 = Data(establishtargetposition_3.output_titleplane_2)
output_interfaceinnercrv_5 = Geometry(establishtargetposition_3.output_interfaceinnercrv_2)
output_textplane_5 = Data(establishtargetposition_3.output_textplane_2)

loadrobot = LoadRobotSystem(Name=list, Base=xy_3)
input_robotsystem = Data(loadrobot)

extr_3 = Extrude(Base=input_basesurface_8, Direction=Z_3)
cap_4 = CapHoles(Brep=extr_3)
output_boundarycollision_4 = Data(cap_4)

output_showorhide_2 = Data(cluster_9.output_showorhide_2)
output_qrcodeplane_2 = Data(output_qrcodeplane)
input_lengthparameter_3 = Data(division_2)

swatch = ColourSwatch(SwatchColor=RGB(255, 0, 0))

rec = DataRecorder(output_robottarget, DataLimit=1, RecordData=True)
input_robotsystem_2 = Data(input_robotsystem)
input_robottarget = Data(rec)

transplane = TranslatedPlane(Plane=output_qrcodeplane_2, XAmount=expr("x*2", input_lengthparameter_3))
filter_3 = StreamFilter(Gate=output_showorhide_2, Stream0=ColourSwatch(SwatchColor=RGBA(89, 89, 89, 6)), Stream1=swatch)

input_titlefontsize_9 = Data(input_titlefontsize_8)
input_titlename_6 = Data(input_titlename_5)
output_titleplane_6 = Data(output_titleplane_5)

output_interfaceinnercrv_6 = Geometry(output_interfaceinnercrv_5)
output_guideoutline_9 = Data(output_guideoutline_7)

input_inudctiontext_6 = Data(input_inudctiontext_5)
output_textplane_6 = Data(output_textplane_5)
input_inductionfontsize_9 = Data(input_inductionfontsize_8)

output_guidesurface_9 = Data(output_guidesurface_7)

input_qrgeometry_3 = Rectangle(input_qrgeometry)
ln = Line(StartPoint=output_qrcodeplane_2, EndPoint=transplane)

midpt = CurveMiddle(Curve=ln)
panel_3 = Panel("""Move the stick and QR code
 closer to the robot and try it
again.""")
move = Move(Geometry=midpt, Motion=Vector(0, 0, 55))  # -> Geometry, Transform
text_dot_5 = ConstructTextDot(Text=panel_3, Point=move.Geometry, Size="15")
filter_4 = StreamFilter(Gate=output_showorhide_2, Stream1=text_dot_5)  # -> flatten(Stream)

text_entity_5 = ConstructTextEntity(
    Text=input_titlename_6,
    Plane=output_titleplane_6,
    Size=input_titlefontsize_9,
    TextHorizontalAlignment=1,
    TextVerticalAlignment=3)
text_entity_6 = ConstructTextEntity(
    Text=input_inudctiontext_6,
    Plane=output_textplane_6,
    Size=input_inductionfontsize_9,
    TextHorizontalAlignment=1,
    TextVerticalAlignment=3)

sync_15 = SyncGeometry(Geometry=output_guidesurface_9, Material=ColourSwatch(SwatchColor=RGBA(64, 64, 64, 27)))

input_qrgeometry_4 = Mesh(input_qrgeometry_3)
mcol = MeshColours(Mesh=input_qrgeometry_4, Colours=swatch)
filter_5 = StreamFilter(Gate=output_showorhide_2, Stream0=input_qrgeometry_4, Stream1=mcol)  # -> flatten(Stream)

display_2 = DisplayMode(1)
sync_16 = SyncGeometry(Geometry=[ln, filter_5, filter_4], Material=filter_3, DisplayMode=display_2)

merge_7 = Merge(
    Data1=flatten(output_interfaceinnercrv_6),
    Data2=flatten(output_guideoutline_9),
    Data3=flatten(text_entity_5),
    Data4=flatten(text_entity_6))
sync_17 = SyncGeometry(Geometry=merge_7)

input_interfacedivision_10 = Slider(9, range=0..100)
input_interfacedivision_11 = Data(input_interfacedivision_10)

# ----
# INDUCTION 04
crv_boundarygeomery_10 = Data(crv_boundarygeomery_2)

input_titlefontsize_10 = Slider(32, range=0..100)
input_titlerow_bottomup_10 = Slider(12, range=0..100)
input_titlerow_bottomup_11 = Data(input_titlerow_bottomup_10)
input_titlefontsize_11 = Data(input_titlefontsize_10)
input_titlename_7 = Data("Induction 04")

panel_4 = Panel("""Select and drag the widget 
to control robot location.""")
input_inductiontextrow_bottomup_10 = Slider(7, range=0..10)
input_inductionfontsize_10 = Slider(15, range=0..100)
input_inductiontextrow_bottomup_11 = Data(input_inductiontextrow_bottomup_10)
input_inductionfontsize_11 = Data(input_inductionfontsize_10)
input_inudctiontext_7 = Data(panel_4)

input_width_mm_10 = Slider(182, range=0..10000)
input_height_mm_10 = Slider(99, range=0..10000)
dom_7 = ConstructDomain(DomainStart=expr("-X", input_width_mm_10), DomainEnd=input_width_mm_10)
dom_8 = ConstructDomain(DomainStart=expr("-X", input_height_mm_10), DomainEnd=input_height_mm_10)
input_height_mm_11 = Data(dom_8)
input_width_mm_11 = Data(dom_7)

input_boxheight_4 = Slider(1200, range=0..10000)
Z_4 = UnitZ(Factor=input_boxheight_4)

data = Data(crv_boundarygeomery_2)
item_4 = ListItem(List=data, Index=-1, Wrap=True)
area_3 = Area(Geometry=item_4)  # -> Area, Centroid
vec = VectorXYZ(XComponent=0, YComponent=Slider(100, range=0..1000), ZComponent=0)  # -> Vector, Length
move_2 = Move(Geometry=area_3.Centroid, Motion=vec.Vector)  # -> Geometry, Transform
xy_4 = XYPlane(Origin=move_2.Geometry)
output_originplane_robot_base = Plane(xy_4)

# ----
# 02
list_2 = RobotsLibrary({"UR3e", "UR5e", "UR10e", "UR16e", "UR3", "UR5", "UR10"}, selected="UR10", Type=0)
input_robot_type_string = Data(list_2)

input_robot_type_string_2 = Data(input_robot_type_string)
input_robotbase_pln = Plane(output_originplane_robot_base)

# ----
# Robot System
robotsystem = ROBOTSYSTEM(input_robot_type_string=input_robot_type_string_2, output_robotbase_pln=input_robotbase_pln)
output_robot_system = Data(robotsystem)

crv_boundarygeomery_11 = Data(crv_boundarygeomery_10)
item_5 = ListItem(List=crv_boundarygeomery_11, Index=4, Wrap=True)

debrep_4 = DeconstructBrep(Brep=item_5)  # -> Faces, Edges, Vertices
input_basesurface_9 = Data(debrep_4.Faces)
input_baseedges_7 = Data(debrep_4.Edges)

input_baseedges_8 = Data(input_baseedges_7)
input_rotationangle_6 = Data(input_rotationangle_2)
input_planeoffsetdistance_6 = Data(input_planeoffsetdistance_2)
input_planeroundedradius_6 = Data(input_planeroundedradius_2)
input_width_mm_12 = Data(input_width_mm_11)
input_height_mm_12 = Data(input_height_mm_11)

input_basesurface_10 = Data(input_basesurface_9)

establishedguidebase_4 = EstablishedGuideBase(
    input_baseedges=input_baseedges_8,
    input_rotationangle=input_rotationangle_6,
    input_planeoffsetdistance=input_planeoffsetdistance_6,
    input_planeroundedradius=input_planeroundedradius_6,
    input_width_mm=input_width_mm_12,
    input_height_mm=input_height_mm_12)  # -> output_guideplane_2, output_guidesurface_2, output_guideoutline_2
output_guidesurface_10 = Data(establishedguidebase_4.output_guidesurface_2)
output_guideoutline_10 = Data(establishedguidebase_4.output_guideoutline_2)
output_guideplane_7 = Data(establishedguidebase_4.output_guideplane_2)

output_guideoutline_11 = Data(output_guideoutline_10)
input_interfaceoffsetdistance_6 = Data(input_interfaceoffsetdistance_2)
output_guidesurface_11 = Data(output_guidesurface_10)
output_guideplane_8 = Data(output_guideplane_7)
input_interfacedivision_12 = Data(input_interfacedivision_11)
input_titlerow_bottomup_12 = Data(input_titlerow_bottomup_11)
input_inductiontextrow_bottomup_12 = Data(input_inductiontextrow_bottomup_11)

establishtargetposition_4 = EstablishTargetPosition(
    output_guideoutline=output_guideoutline_11,
    input_interfaceoffsetdistance=input_interfaceoffsetdistance_6,
    output_guidesurface=output_guidesurface_11,
    output_guideplane=output_guideplane_8,
    input_interfacedivision=input_interfacedivision_12,
    input_titlerow_bottomup=input_titlerow_bottomup_12,
    input_inductiontextrow_bottomup=input_inductiontextrow_bottomup_12)  # -> output_interfaceinnercrv_2, output_titleplane_2, output_textplane_2
output_titleplane_7 = Data(establishtargetposition_4.output_titleplane_2)
output_interfaceinnercrv_7 = Geometry(establishtargetposition_4.output_interfaceinnercrv_2)
output_textplane_7 = Data(establishtargetposition_4.output_textplane_2)

extr_4 = Extrude(Base=input_basesurface_10, Direction=Z_4)
cap_5 = CapHoles(Brep=extr_4)
output_boundarycollision_5 = Data(cap_5)

# ----
# 01
pt_2 = Point(Point(3350.171102, 407.1836528, 288.8007362))
# Establish Widget
yz = YZPlane(Origin=pt_2)

# ---- group: GET BASE GEOMETRY ii
xy_5 = XYPlane(Origin=Point(0, 0, 0))
input_widgetplane = Data(yz)
number_slider_2 = Slider(25, range=0..1000)

# ---- group: GET BASE GEOMETRY i
input_widgetplane_2 = Data(yz)
number_slider_3 = Slider(14, range=0..100)

# ----
output_interfaceinnercrv_8 = Geometry(output_interfaceinnercrv_7)
output_guideoutline_12 = Data(output_guideoutline_10)

input_titlename_8 = Data(input_titlename_7)
output_titleplane_8 = Data(output_titleplane_7)
input_titlefontsize_12 = Data(input_titlefontsize_11)

output_textplane_8 = Data(output_textplane_7)
input_inductionfontsize_12 = Data(input_inductionfontsize_11)
input_inudctiontext_8 = Data(input_inudctiontext_7)

output_guidesurface_12 = Data(output_guidesurface_10)

# ---- group: GET BASE GEOMETRY i / CREATE A BOX
dom_9 = ConstructDomain(DomainStart=expr("-x", number_slider_3), DomainEnd=number_slider_3)
box_4 = DomainBox(Base=input_widgetplane_2, X=dom_9, Y=dom_9, Z=dom_9)
mbox = MeshBox(Base=box_4, XCount=10, YCount=10, ZCount=1)
input_prelimwdigetbox = Data(mbox)

# ----
display_3 = DisplayMode(0)
fologram_geo_dome = Data(flatten([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]))

display_4 = DisplayMode(0)
fologram_geo_dome_2 = Data(flatten([{Angle=0, Angle=3.337753158, Plane=Plane(origin=(0, 0, 127.3), x=(-0.9951939866, 0, -0.09792307692), y=(-0.09792307692, 0, 0.9951939866)), Radius=1300}, {Angle=0, Angle=3.337753158, Plane=Plane(origin=(0, 0, 127.3), x=(-0.9194393551, -0.3808442507, -0.09792307692), y=(-0.09046912653, -0.03747353918, 0.9951939866)), Radius=1300}, {Angle=0, Angle=3.337753158, Plane=Plane(origin=(0, 0, 127.3), x=(-0.7037084165, -0.7037084165, -0.09792307692), y=(-0.06924207173, -0.06924207173, 0.9951939866)), Radius=1300}, {Angle=0, Angle=3.337753158, Plane=Plane(origin=(0, 0, 127.3), x=(-0.3808442507, -0.9194393551, -0.09792307692), y=(-0.03747353918, -0.09046912653, 0.9951939866)), Radius=1300}, {Angle=0, Angle=3.337753158, Plane=Plane(origin=(0, 0, 127.3), x=(0, -0.9951939866, -0.09792307692), y=(0, -0.09792307692, 0.9951939866)), Radius=1300}, {Angle=0, Angle=3.337753158, Plane=Plane(origin=(0, 0, 127.3), x=(0.3808442507, -0.9194393551, -0.09792307692), y=(0.03747353918, -0.09046912653, 0.9951939866)), Radius=1300}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]))

xy_6 = XYPlane(Origin=Point(0, 0, 0))
data_2 = Data(input_robotbase_pln)

# ---- group: GET BASE GEOMETRY ii
pt_3 = ConstructPoint(XCoordinate=0, YCoordinate=0, ZCoordinate=number_slider_2)
box_5 = CenterBox(Base=xy_5, X=1.5, Y=1.5, Z=number_slider_2)

# ----
text_entity_7 = ConstructTextEntity(
    Text=input_titlename_8,
    Plane=output_titleplane_8,
    Size=input_titlefontsize_12,
    TextHorizontalAlignment=1,
    TextVerticalAlignment=3)
text_entity_8 = ConstructTextEntity(
    Text=input_inudctiontext_8,
    Plane=output_textplane_8,
    Size=input_inductionfontsize_12,
    TextHorizontalAlignment=1,
    TextVerticalAlignment=3)

sync_18 = SyncGeometry(Geometry=output_guidesurface_12, Material=ColourSwatch(SwatchColor=RGBA(64, 64, 64, 27)))

# ---- group: GET BASE GEOMETRY ii
mbox_2 = MeshBox(Base=box_5, XCount=3, YCount=3, ZCount=1)
orient_4 = Orient(Geometry=mbox_2, Source=pt_3, Target=input_widgetplane)  # -> Geometry, Transform
input_prelimwdigetstick = Data(orient_4.Geometry)

# ---- group: CREATE THE FINAL WIDGET GEOMETRY AND RIGHT LOCATION
interaction_2 = InteractionType(6)
input_stick = Data(input_prelimwdigetstick)
input_box = Data(input_prelimwdigetbox)
input_widgetplane_3 = Data(yz)
mjoin = MeshJoin(Meshes=[input_box, input_stick])

sync_19 = SyncGeometry(Geometry=mjoin, Interactions=interaction_2)

transform = Transform(Geometry=input_widgetplane_3, Transform=sync_19)  # -> flatten(Geometry)
output_updatedwdigetplane = Data(transform)

# ----
merge_8 = Merge(
    Data1=flatten(output_interfaceinnercrv_8),
    Data2=flatten(output_guideoutline_12),
    Data3=flatten(text_entity_7),
    Data4=flatten(text_entity_8))
sync_20 = SyncGeometry(Geometry=merge_8)

vec2pt = Vector2Pt(PointA=xy_6, PointB=data_2, Unitize=False)  # -> Vector, Length
move_3 = Move(Geometry=fologram_geo_dome, Motion=vec2pt.Vector)  # -> Geometry, Transform
sync_21 = SyncGeometry(Geometry=move_3.Geometry, Material=ColourSwatch(SwatchColor=RGBA(82, 82, 82, 245)), DisplayMode=display_3)

vec2pt_2 = Vector2Pt(PointA=xy_6, PointB=data_2, Unitize=False)  # -> Vector, Length
move_4 = Move(Geometry=fologram_geo_dome_2, Motion=vec2pt_2.Vector)  # -> Geometry, Transform
sync_22 = SyncGeometry(Geometry=move_4.Geometry, Material=ColourSwatch(SwatchColor=RGBA(89, 89, 89, 6)), DisplayMode=display_4)

K = Kinematics(RobotSystem=input_robotsystem_2, Target=input_robottarget, DisplayGeometry=True)  # -> Meshes, Joints, Planes, Errors
cull_i = CullIndex(List=K.Meshes, Indices=-1, Wrap=True)
display_5 = DisplayMode(0)

null_3 = NullItem(Item=K.Errors)  # -> NullFlags, InvalidFlags, Description
filter_6 = StreamFilter(
    Gate=null_3.NullFlags,
    Stream0=ColourSwatch(SwatchColor=RGB(255, 0, 0)),
    Stream1=ColourSwatch(SwatchColor=RGBA(89, 89, 89, 6)))

sync_23 = SyncGeometry(Geometry=cull_i, Material=filter_6, DisplayMode=display_5)

output_updatedwdigetplane_2 = Data(output_updatedwdigetplane)
flippln = FlipPlane(Plane=output_updatedwdigetplane_2, FlipX=False, FlipY=False, FlipZ=True)  # -> Flipped, R
target = CreateTarget(Plane=flippln.Flipped, IsCartesian=True)

K_2 = Kinematics(RobotSystem=output_robot_system, Target=target, DisplayGeometry=True)  # -> Meshes, Joints, Planes, Errors
cull_i_2 = CullIndex(List=K_2.Meshes, Indices=-1, Wrap=True)

display_6 = DisplayMode(0)
null_4 = NullItem(Item=K_2.Errors)  # -> NullFlags, InvalidFlags, Description
filter_7 = StreamFilter(
    Gate=null_4.NullFlags,
    Stream0=ColourSwatch(SwatchColor=RGB(255, 0, 0)),
    Stream1=ColourSwatch(SwatchColor=RGBA(255, 255, 255, 36)))

sync_24 = SyncGeometry(Geometry=cull_i_2, Material=filter_7, DisplayMode=display_6)

# ==== cluster Cluster
input_pinchpoint = ClusterInput()
Z = UnitZ(Factor=Slider(42, range=0..100))
input_pinchpoint_2 = Data(input_pinchpoint)
move = Move(Geometry=input_pinchpoint_2, Motion=Z)  # -> Geometry, Transform
number_slider = ClusterOutput(Slider(20, range=0..100))
G = ClusterOutput(move.Geometry)

# ==== cluster Cluster_2
input_pinchpoint = ClusterInput()
number_slider = Slider(10, range=0..10)
input_pinchpoint_2 = Data(input_pinchpoint)
msphere = MeshSphere(Base=input_pinchpoint_2, Radius=10, UCount=number_slider, VCount=number_slider)
input_meshsphere = Data(msphere)
input_meshsphere_2 = ClusterOutput(input_meshsphere)

# ==== cluster Cluster_3
L = ClusterInput()
panel = Panel("""5
10""")
item = ListItem(List=L, Index=panel, Wrap=True)
avr = Average(Input=item)
input_pinchpoint = Data(avr)
input_pinchpoint_2 = ClusterOutput(input_pinchpoint)

# ==== cluster Cluster_4
input_zoningnumber = ClusterInput()
input_zoning = ClusterInput()
input_zoningnumber_2 = Data(input_zoningnumber)
input_zoning_2 = Data(input_zoning)
input_pinchpoint = ClusterInput()
input_pinchpoint_2 = Data(input_pinchpoint)
item = ListItem(List=input_zoning_2, Index=input_zoningnumber_2, Wrap=True)
brepinc = PointInBrep(Brep=item, Point=input_pinchpoint_2, Strict=False)
I = ClusterOutput(brepinc)

# ==== cluster ROBOTSYSTEM
input_robot_type_string = ClusterInput()
output_robotbase_pln = ClusterInput()

# ---- group: ESTABLISH ROBOT TYPE
# 01
# NOTE(S): Please reconfigure robot base if you are not using UR10
input_robot_type_string_2 = Data(input_robot_type_string)
output_robotbase_pln_2 = Plane(output_robotbase_pln)

# ---- group: RETRIEVE ROBOT GEOMETRY
# Establish robot geometry
loadrobot = LoadRobotSystem(Name=input_robot_type_string_2, Base=output_robotbase_pln_2)

# ----
output_robot_system = Data(loadrobot)
output_robot_system_2 = ClusterOutput(output_robot_system)

# ==== cluster LOY_Boundary
I = ClusterInput()
ma = MassAddition(Input=I)  # -> Result, PartialResults
Y = ClusterInput()
vec = VectorXYZ(XComponent=ma.PartialResults, YComponent=0, ZComponent=0)  # -> Vector, Length
pt = ConstructPoint(XCoordinate=0, YCoordinate=0, ZCoordinate=0)
vec_2 = VectorXYZ(XComponent=ma.PartialResults, YComponent=Y, ZComponent=0)  # -> Vector, Length
move = Move(Geometry=pt, Motion=vec_2.Vector)  # -> Geometry, Transform
move_2 = Move(Geometry=pt, Motion=vec.Vector)  # -> Geometry, Transform
merge = Merge(Data1=flatten(pt), Data2=flatten(move_2.Geometry))
cull_i = CullIndex(List=merge, Indices=-1, Wrap=True)
rec_2pt = Rectangle2Pt(Plane=PlaneXY(0, 0, 0), PointA=cull_i, PointB=move.Geometry, Radius=0)  # -> Rectangle, Length
data = Data(rec_2pt.Rectangle)
data_2 = ClusterOutput(data)

# ==== cluster EstablishedGuideBase
input_rotationangle = ClusterInput()
input_planeroundedradius = ClusterInput()
input_baseedges = ClusterInput()
input_planeoffsetdistance = ClusterInput()
input_height_mm = ClusterInput()
input_width_mm = ClusterInput()
input_rotationangle_2 = Data(input_rotationangle)
input_planeroundedradius_2 = Data(input_planeroundedradius)
input_baseedges_2 = Data(input_baseedges)
input_planeoffsetdistance_2 = Data(input_planeoffsetdistance)
input_height_mm_2 = Data(input_height_mm)
input_width_mm_2 = Data(input_width_mm)
item = ListItem(List=input_baseedges_2, Index=0, Wrap=True)
midpt = CurveMiddle(Curve=item)
end = EndPoints(Curve=item)  # -> Start, End
xy = XYPlane(Origin=midpt)
vec2pt = Vector2Pt(PointA=end.Start, PointB=end.End, Unitize=False)  # -> Vector, Length
rot3d = Rotate3D(Geometry=xy, Angle=degrees(input_rotationangle_2), Center=xy, Axis=vec2pt.Vector)  # -> Geometry, Transform
pl_offset = PlaneOffset(BasePlane=rot3d.Geometry, Offset=input_planeoffsetdistance_2)
rectangle = Rectangle(Plane=pl_offset, XSize=input_width_mm_2, YSize=input_height_mm_2, Radius=input_planeroundedradius_2)  # -> Rectangle, Length
output_guideplane = Data(pl_offset)
boundary = BoundarySurfaces(Edges=rectangle.Rectangle)
output_guideoutline = Data(rectangle.Rectangle)
output_guidesurface = Data(boundary)
output_guideplane_2 = ClusterOutput(output_guideplane)
output_guideoutline_2 = ClusterOutput(output_guideoutline)
output_guidesurface_2 = ClusterOutput(output_guidesurface)

# ==== cluster EstablishTargetPosition
input_inductiontextrow_bottomup = ClusterInput()
input_titlerow_bottomup = ClusterInput()
input_interfaceoffsetdistance = ClusterInput()
output_guideoutline = ClusterInput()
input_inductiontextrow_bottomup_2 = Data(input_inductiontextrow_bottomup)
input_titlerow_bottomup_2 = Data(input_titlerow_bottomup)
input_interfaceoffsetdistance_2 = Data(input_interfaceoffsetdistance)
output_guideoutline_2 = Data(output_guideoutline)
input_interfacedivision = ClusterInput()
output_guideplane = ClusterInput()
output_guidesurface = ClusterInput()
input_interfacedivision_2 = Data(input_interfacedivision)
output_guideplane_2 = Data(output_guideplane)
output_guideplane_3 = Data(output_guideplane_2)
output_guidesurface_2 = Data(output_guidesurface)
neg = Negative(Value=input_interfaceoffsetdistance_2)
contour = Contour(Shape=output_guidesurface_2, Point=output_guideplane_2, Direction=Vector(0, 0, 1), Distance=input_interfacedivision_2)  # -> flatten(Contours)
offset = OffsetCurve(Curve=output_guideoutline_2, Distance=neg, Corners=1)
output_interfaceinnercrv = Geometry(offset)
ouput_guidelines = Data(contour)
ouput_guidelines_2 = Data(ouput_guidelines)
item = ListItem(List=ouput_guidelines_2, Index=input_titlerow_bottomup_2, Wrap=True)
item_2 = ListItem(List=ouput_guidelines_2, Index=input_inductiontextrow_bottomup_2, Wrap=True)
midpt = CurveMiddle(Curve=item)
midpt_2 = CurveMiddle(Curve=item_2)
pl_origin = PlaneOrigin(Base=output_guideplane_3, Origin=midpt)
pl_origin_2 = PlaneOrigin(Base=output_guideplane_3, Origin=midpt_2)
output_titleplane = Data(pl_origin)
output_textplane = Data(pl_origin_2)
output_titleplane_2 = ClusterOutput(output_titleplane)
output_textplane_2 = ClusterOutput(output_textplane)
output_interfaceinnercrv_2 = ClusterOutput(output_interfaceinnercrv)

# ==== cluster Cluster_5
input_qrplane = ClusterInput()
input_qrgeometry = ClusterInput()
input_lengthparameter = ClusterInput()
input_maximumoperationalrange = ClusterInput()
input_ur10_base = ClusterInput()
input_qrplane_2 = Plane(input_qrplane)
input_qrgeometry_2 = Rectangle(input_qrgeometry)
input_lengthparameter_2 = Data(input_lengthparameter)
input_maximumoperationalrange_2 = Data(input_maximumoperationalrange)
input_ur10_base_2 = Data(input_ur10_base)
input_qrgeometry_3 = Rectangle(input_qrgeometry_2)
input_qrplane_3 = Plane(input_qrplane_2)
area = Area(Geometry=input_qrgeometry_3)  # -> Area, Centroid
pl_origin = PlaneOrigin(Base=input_qrplane_3, Origin=area.Centroid)
output_qrcodeplane = Data(pl_origin)
input_lengthparameter_3 = Data(input_lengthparameter_2)
transplane = TranslatedPlane(Plane=output_qrcodeplane, XAmount=expr("x", input_lengthparameter_3))
output_qrcodeplane_2 = ClusterOutput(output_qrcodeplane)
input_maximumoperationalrange_3 = Data(input_maximumoperationalrange_2)
input_ur10_base_3 = Data(input_ur10_base_2)
output_tcpplane = Data(transplane)
dist = Distance(PointA=output_tcpplane, PointB=input_ur10_base_3)
larger = LargerThan(FirstNumber=dist, SecondNumber=input_maximumoperationalrange_3)  # -> LargerThan, OrEqualTo
output_showorhide = Data(larger.LargerThan)
cull = CullPattern(List=output_tcpplane, CullPattern=invert(larger.LargerThan))
output_robottarget = TargetParameter(flatten(cull))
output_showorhide_2 = ClusterOutput(output_showorhide)
output_robottarget_2 = ClusterOutput(output_robottarget)
